# Grasshopper definition Workbench_GLTF_Export.ghx (Grasshopper 1.0.8)
# Copyright: 2021
# plug-ins: RhinoCodePluginGH, AutosaveManager, Web_Exporter

# ---- group: scene
number_slider = Slider(0.01, range=0..0.01)
number_slider_2 = Slider(20, range=0..100)
multiplication = Multiplication(A=number_slider, B=Slider(3.083, range=0..10))
box = CenterBox(Base=PlaneXY(0, 0, 0), X=number_slider, Y=number_slider, Z=number_slider)
rectangle = Rectangle(Plane=PlaneXY(0, 0, 0), XSize=multiplication, YSize=multiplication, Radius=0)  # -> Rectangle, Length
arrrec = RectangularArray(Geometry=box, Cell=rectangle.Rectangle, XCount=number_slider_2, YCount=number_slider_2)  # -> Geometry, Transform

# ----
autosavemanager = AutosaveUnsavedManager()
gltfoptions = FileGltfWriteOptions(
    cullBackfaces=True,
    dracoCompressionLevel=10,
    dracoQuantizationBitsNormal=8,
    dracoQuantizationBitsPosition=11,
    dracoQuantizationBitsTextureCoordinate=10,
    exportLayers=False,
    exportMaterials=True,
    exportOpenMeshes=True,
    exportTextureCoordinates=True,
    exportVertexColors=True,
    exportVertexNormals=True,
    mapZToY=True,
    subDMeshType=0,
    subDSurfaceMeshingDensity=4,
    useDisplayColorForUnsetMaterials=True,
    useDracoCompression=True)  # -> out, options, archiveCollection; inputs cullBackfaces: Boolean, dracoCompressionLevel: Int32, dracoQuantizationBitsNormal: Int32, dracoQuantizationBitsPosition: Int32, dracoQuantizationBitsTextureCoordinate: Int32, exportLayers: Boolean, exportMaterials: Boolean, exportOpenMeshes: Boolean, exportTextureCoordinates: Boolean, exportVertexColors: Boolean, exportVertexNormals: Boolean, mapZToY: Boolean, subDMeshType: Int32, subDSurfaceMeshingDensity: Int32, useDisplayColorForUnsetMaterials: Boolean, useDracoCompression: Boolean
# ---------- gltfoptions: C# ----------
// Grasshopper Script Instance
#region Usings
using System;
using System.Linq;
using System.Collections;
using System.Collections.Generic;
using System.Drawing;

using Rhino;
using Rhino.Geometry;
using Rhino.FileIO;

using Grasshopper;
using Grasshopper.Kernel;
using Grasshopper.Kernel.Data;
using Grasshopper.Kernel.Types;
#endregion

public class Script_Instance : GH_ScriptInstance
{
    #region Notes
    /* 
      Members:
        RhinoDoc RhinoDocument
        GH_Document GrasshopperDocument
        IGH_Component Component
        int Iteration

      Methods (Virtual & overridable):
        Print(string text)
        Print(string format, params object[] args)
        Reflect(object obj)
        Reflect(object obj, string method_name)
    */
    #endregion
    private bool initialized = false;

    private void RunScript(
	bool cullBackfaces,
	int dracoCompressionLevel,
	int dracoQuantizationBitsNormal,
	int dracoQuantizationBitsPosition,
	int dracoQuantizationBitsTextureCoordinate,
	bool exportLayers,
	bool exportMaterials,
	bool exportOpenMeshes,
	bool exportTextureCoordinates,
	bool exportVertexColors,
	bool exportVertexNormals,
	bool mapZToY,
	int subDMeshType,
	int subDSurfaceMeshingDensity,
	bool useDisplayColorForUnsetMaterials,
	bool useDracoCompression,
	ref object options,
	ref object archiveCollection)
    {
        if (!initialized)
        {
            initialized = true;
            Component.NickName = "GltfOptions";
            Component.Name = "FileGltfWriteOptions";
            Component.Description = "Options used when writing a glTF file.";
            Component.Params.Output.Find(i=>i.NickName == "options").Name = "FileGltfWriteOptions";
            Component.Params.Output.Find(i=>i.NickName == "options").Description = "Write file options.";
            Component.Params.Output.Find(i=>i.NickName == "archiveCollection").Name = "ArchivableDictionary";
            Component.Params.Output.Find(i=>i.NickName == "archiveCollection").Description = "Export selection options.";
            Component.Params.Input.Find(i=>i.NickName == "cullBackfaces").Name = "CullBackfaces property";
            Component.Params.Input.Find(i=>i.NickName == "cullBackfaces").Description = "Setting that determines whether or not the meshes in the glTF will be rendered with or without backface culling. Known as DoubleSided in the glTF specification.";
            Component.Params.Input.Find(i=>i.NickName == "dracoCompressionLevel").Name = "DracoCompressionLevel property";
            Component.Params.Input.Find(i=>i.NickName == "dracoCompressionLevel").Description = "The level of compression used by draco in the range of 1 to 10 inclusive.";
            Component.Params.Input.Find(i=>i.NickName == "dracoQuantizationBitsNormal").Name = "DracoQuantizationBitsNormal property";
            Component.Params.Input.Find(i=>i.NickName == "dracoQuantizationBitsNormal").Description = "The number of bits used when quantizing mesh normals in the range of 8 to 32 inclusive.";
            Component.Params.Input.Find(i=>i.NickName == "dracoQuantizationBitsPosition").Name = "DracoQuantizationBitsPosition property";
            Component.Params.Input.Find(i=>i.NickName == "dracoQuantizationBitsPosition").Description = "The number of bits used when quantizing mesh vertex positions in the range of 8 to 32 inclusive.";
            Component.Params.Input.Find(i=>i.NickName == "dracoQuantizationBitsTextureCoordinate").Name = "DracoQuantizationBitsTextureCoordinate property";
            Component.Params.Input.Find(i=>i.NickName == "dracoQuantizationBitsTextureCoordinate").Description = "The number of bits used when quantizing mesh texture coordinates in the range of 8 to 32 inclusive.";
            Component.Params.Input.Find(i=>i.NickName == "exportLayers").Name = "ExportLayers property";
            Component.Params.Input.Find(i=>i.NickName == "exportLayers").Description = "glTF uses a scene hierarchy structure where nodes are organized in a parent-child relationship. This setting enables/disables the writing of empty nodes with the same names as layers and places exported objects a children of the corresponding layer node.";
            Component.Params.Input.Find(i=>i.NickName == "exportMaterials").Name = "ExportMaterials property";
            Component.Params.Input.Find(i=>i.NickName == "exportMaterials").Description = "Setting to determine whether or not materials are written to the glTF file.";
            Component.Params.Input.Find(i=>i.NickName == "exportOpenMeshes").Name = "ExportOpenMeshes property";
            Component.Params.Input.Find(i=>i.NickName == "exportOpenMeshes").Description = "Enable/disable the exporting of open meshes.";
            Component.Params.Input.Find(i=>i.NickName == "exportTextureCoordinates").Name = "ExportTextureCoordinates property";
            Component.Params.Input.Find(i=>i.NickName == "exportTextureCoordinates").Description = "Enable/disable the exporting of texture coordinates.";
            Component.Params.Input.Find(i=>i.NickName == "exportVertexColors").Name = "ExportVertexColors property";
            Component.Params.Input.Find(i=>i.NickName == "exportVertexColors").Description = "Enable/disable the export of vertex colors.";
            Component.Params.Input.Find(i=>i.NickName == "exportVertexNormals").Name = "ExportVertexNormals property";
            Component.Params.Input.Find(i=>i.NickName == "exportVertexNormals").Description = "Enable/disable the exporting of vertex normals.";
            Component.Params.Input.Find(i=>i.NickName == "mapZToY").Name = "MapZToY property";
            Component.Params.Input.Find(i=>i.NickName == "mapZToY").Description = "Setting to transform Rhino's Z axis to glTF's Y axis.";
            Component.Params.Input.Find(i=>i.NickName == "subDMeshType").Name = "SubDMeshType property";
            Component.Params.Input.Find(i=>i.NickName == "subDMeshType").Description = "The mesh type for exported SubDs.";
            Component.Params.Input.Find(i=>i.NickName == "subDSurfaceMeshingDensity").Name = "SubDSurfaceMeshingDensity property";
            Component.Params.Input.Find(i=>i.NickName == "subDSurfaceMeshingDensity").Description = "Determines how coarse the mesh output will be when surface meshing subd objects See comments for ON_SubDDisplayParameters in opennurbs_mesh.h for details regarding numbers used.";
            Component.Params.Input.Find(i=>i.NickName == "useDisplayColorForUnsetMaterials").Name = "UseDisplayColorForUnsetMaterials property";
            Component.Params.Input.Find(i=>i.NickName == "useDisplayColorForUnsetMaterials").Description = "Setting to display color as material when material index for object is -1.";
            Component.Params.Input.Find(i=>i.NickName == "useDracoCompression").Name = "UseDracoCompression property";
            Component.Params.Input.Find(i=>i.NickName == "useDracoCompression").Description = "Enable/disable the use of Draco mesh compression in the glTF file.";
        }
        FileGltfWriteOptions optionsGltf = new FileGltfWriteOptions(){
            CullBackfaces = cullBackfaces,
            DracoCompressionLevel = dracoCompressionLevel,
            DracoQuantizationBitsNormal = dracoQuantizationBitsNormal,
            DracoQuantizationBitsPosition = dracoQuantizationBitsPosition,
            DracoQuantizationBitsTextureCoordinate = dracoQuantizationBitsTextureCoordinate,
            ExportLayers = exportLayers,
            ExportMaterials = exportMaterials,
            ExportOpenMeshes = exportOpenMeshes,
            ExportTextureCoordinates = exportTextureCoordinates,
            ExportVertexColors = exportVertexColors,
            ExportVertexNormals = exportVertexNormals,
            MapZToY = mapZToY,
            SubDMeshType = (FileGltfWriteOptions.SubDMeshing)subDMeshType,
            SubDSurfaceMeshingDensity = subDSurfaceMeshingDensity,
            UseDisplayColorForUnsetMaterials = useDisplayColorForUnsetMaterials,
            UseDracoCompression = useDracoCompression
        };
        options = optionsGltf;
        archiveCollection = optionsGltf.ToDictionary();
    }
}
# ---------- end gltfoptions ----------
panel = Panel(autosavemanager)
data = Data({ContentXML="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", Path="PBM Corian - DuPont"})

# ---- group: materials
materials = QueryModelMaterials(AutoUpdateState=True)
material = ModelMaterial(Material=data)  # -> Material, Name, Shader
item = ListItem(List=material.Name, Index=0, Wrap=True)  # -> Item, Item1

# ---- group: Geometry
geo = Geometry(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)
mbox = MeshBox(Base=geo, XCount=10, YCount=10, ZCount=10)

# ----
button = Button()
panel_2 = Panel(material.Name)
panel_3 = Panel(gltfoptions.archiveCollection)
write_exportgltf = Script(
    geo=mbox,
    name="model_03(VS)",
    material=item.Item1,
    options=gltfoptions.options,
    aCollection=gltfoptions.archiveCollection)  # -> out; inputs export: Boolean, geo: GeometryBase, name: String, material: String, aCollection: list
# ---------- write_exportgltf: C# ----------
// Grasshopper Script Instance
#region Usings
using System;
using System.Linq;
using System.Collections;
using System.Collections.Generic;
using System.Drawing;

using Rhino;
using Rhino.Geometry;
using Rhino.FileIO;

using Grasshopper;
using Grasshopper.Kernel;
using Grasshopper.Kernel.Data;
using Grasshopper.Kernel.Types;
#endregion

public class Script_Instance : GH_ScriptInstance
{
    #region Notes
    /* 
      Members:
        RhinoDoc RhinoDocument
        GH_Document GrasshopperDocument
        IGH_Component Component
        int Iteration

      Methods (Virtual & overridable):
        Print(string text)
        Print(string format, params object[] args)
        Reflect(object obj)
        Reflect(object obj, string method_name)
    */
    #endregion
    private string _lastResult = "";

    private void RunScript(
	bool export,
	GeometryBase geo,
	string name,
	string material,
	object options,
	IList<object> aCollection)
    {
        bool scene = false;
        Component.Message = "Geometry";
        if (((IGH_Param)Component.Params.Input[1]).VolatileDataCount < 1)
        {
            string msg = "Writing entire scene since \"geo\" failed to collect data";
            ((IGH_Component)Component).AddRuntimeMessage(GH_RuntimeMessageLevel.Remark, msg);
            Print(msg);
            scene = true;
            Component.Message = "Scene";
        }
        FileGltfWriteOptions optionsGltf = 
            Component.Params.Input.Find(i=>i.NickName=="options").VolatileDataCount > 1
            && options is FileGltfWriteOptions
            && !scene?
            options as FileGltfWriteOptions :
            // default settings:
            new FileGltfWriteOptions(){
                CullBackfaces = true,
                DracoCompressionLevel = 10,
                DracoQuantizationBitsNormal = 8,
                DracoQuantizationBitsPosition = 11,
                DracoQuantizationBitsTextureCoordinate = 10,
                ExportLayers = false,
                ExportMaterials = true,
                ExportOpenMeshes = true,
                ExportTextureCoordinates = true,
                ExportVertexColors = true,
                ExportVertexNormals = true,
                MapZToY = true,
                SubDMeshType = FileGltfWriteOptions.SubDMeshing.Surface,
                SubDSurfaceMeshingDensity = 4,
                UseDisplayColorForUnsetMaterials = true,
                UseDracoCompression = true
            };
        Rhino.Collections.ArchivableDictionary archiveCollection =
            scene && aCollection is Rhino.Collections.ArchivableDictionary?
            aCollection as Rhino.Collections.ArchivableDictionary:
            optionsGltf.ToDictionary();
        
        var filePath = @"C:\Data\CloudFlare\3d-models\ReceivingGH_GLTFs";
        filePath += $@"\{name}.gltf";

        if (!export) return;
        string res = "";
        Guid id = Guid.Empty;
        try
        {
            if (!scene)
            {
                // creating temporary geometry
                Rhino.DocObjects.ObjectAttributes att = new Rhino.DocObjects.ObjectAttributes();
                att.LayerIndex = 0;
                att.MaterialSource = Rhino.DocObjects.ObjectMaterialSource.MaterialFromLayer;
                id = RhinoDocument.Objects.Add(geo, att);
                Rhino.RhinoApp.Write("Object baked\n", true);

                // select the object
                RhinoDocument.Objects.Select(id, true);
                Rhino.RhinoApp.Write("Object selected\n", true);

                // Assign the material to the object if it exists
                var materialRH = RhinoDocument.RenderMaterials.FirstOrDefault(n=>n.Name == material, null);
                if (materialRH != null)
                {
                    var rhObj = RhinoDocument.Objects.FindId(id);
                    rhObj.RenderMaterial = materialRH;
                    rhObj.CommitChanges();
                    RhinoDocument.Views.Redraw();
                    Rhino.RhinoApp.Write("Object material assigned\n", true);
                }

                // attempt export temp baked object
                if (((RhinoDoc)RhinoDocument).ExportSelected(filePath, archiveCollection))
                    res = $"File written successfully to path: {filePath}";
                else res = "Something went wrong";
            }
            else
            {
                // attempt export entire document scene
                if (Rhino.FileIO.FileGltf.Write(filePath, RhinoDocument, optionsGltf))
                     res = $"File written successfully to path: {filePath}";
                else res = "Something went wrong";
            }
        }
        catch (Exception e)
        {
            res += "\nError\n"+e;
        }
        finally
        {
            Rhino.RhinoApp.Write("Export attempted\n", true);
            if (!scene)
            {
                // delete baked geometry quiet
                RhinoDocument.Objects.Delete(id, true);
                Rhino.RhinoApp.Write("Object deleted\n", true);
            }
            _lastResult = res;
        }
        Print(_lastResult);
    }
}
# ---------- end write_exportgltf ----------
script = Script(export=button, geo=mbox)  # -> out; inputs export: Boolean, geo: GeometryBase; disabled
# ---------- script: C# ----------
// Grasshopper Script Instance
#region Usings
using System;
using System.Linq;
using System.Collections;
using System.Collections.Generic;
using System.Drawing;

using Rhino;
using Rhino.Geometry;
using Rhino.FileIO;

using Grasshopper;
using Grasshopper.Kernel;
using Grasshopper.Kernel.Data;
using Grasshopper.Kernel.Types;
#endregion

public class Script_Instance : GH_ScriptInstance
{
    #region Notes
    /* 
      Members:
        RhinoDoc RhinoDocument
        GH_Document GrasshopperDocument
        IGH_Component Component
        int Iteration

      Methods (Virtual & overridable):
        Print(string text)
        Print(string format, params object[] args)
        Reflect(object obj)
        Reflect(object obj, string method_name)
    */
    #endregion

    private void RunScript(bool export, GeometryBase geo)
    {
        if (((IGH_Param)Component.Params.Input[1]).VolatileDataCount < 1)
        {
            string msg = "Input \"geo\" failed to collect data";
            ((IGH_Component)Component).AddRuntimeMessage(GH_RuntimeMessageLevel.Warning, msg);
            Print(msg);
            return;
        }
        // default settings:
        var cullBackfaces = true;
        var dracoCompressionLevel = 10;
        var dracoQuantizationBitsNormal = 8;
        var dracoQuantizationBitsPosition = 11;
        var dracoQuantizationBitsTextureCoordinate = 10;
        var exportLayers = false;
        var exportMaterials = true;
        var exportOpenMeshes = true;
        var exportTextureCoordinates = true;
        var exportVertexColors = true;
        var exportVertexNormals = true;
        var mapZToY = true;
        var subDMeshType = FileGltfWriteOptions.SubDMeshing.ControlNet;
        var subDSurfaceMeshingDensity = 4;
        var useDisplayColorForUnsetMaterials = true;
        var useDracoCompression = true;
        FileGltfWriteOptions options = new FileGltfWriteOptions(){
            CullBackfaces = cullBackfaces,
            DracoCompressionLevel = dracoCompressionLevel,
            DracoQuantizationBitsNormal = dracoQuantizationBitsNormal,
            DracoQuantizationBitsPosition = dracoQuantizationBitsPosition,
            DracoQuantizationBitsTextureCoordinate = dracoQuantizationBitsTextureCoordinate,
            ExportLayers = exportLayers,
            ExportMaterials = exportMaterials,
            ExportOpenMeshes = exportOpenMeshes,
            ExportTextureCoordinates = exportTextureCoordinates,
            ExportVertexColors = exportVertexColors,
            ExportVertexNormals = exportVertexNormals,
            MapZToY = mapZToY,
            SubDMeshType = subDMeshType,
            SubDSurfaceMeshingDensity = subDSurfaceMeshingDensity,
            UseDisplayColorForUnsetMaterials = useDisplayColorForUnsetMaterials,
            UseDracoCompression = useDracoCompression
        };
        var filePath = @"C:\Data\CloudFlare\3d-models\ReceivingGH_GLTFs";
        filePath += @"\model1.gltf";
        // creating temporary file:
        /*RhinoDoc docTemp = new RhinoDoc();
        docTemp.RenderSettings = ((RhinoDoc)RhinoDocument).RenderSettings;
        // maybe add a layer if necessary here for the next step
        Rhino.DocObjects.ObjectAttributes att = new Rhino.DocObjects.ObjectAttributes();
        att.LayerIndex = 0;
        docTemp.Objects.Add(geo, att);
        */

        if (!export) return;
        string res = "";
        Guid id = Guid.Empty;
        try
        {
            // creating temporary geometry
            id = RhinoDocument.Objects.Add(geo);
            Rhino.RhinoApp.Write("Object baked\n", true);

            // attempt export
            if (Rhino.FileIO.FileGltf.Write(filePath, RhinoDocument, options))
                 res = $"File written successfully to path: {filePath}";
            else res = "Something went wrong";
        }
        catch (Exception e)
        {
            res += "\nError\n"+e;
        }
        finally
        {
            Rhino.RhinoApp.Write("Export attempted\n", true);            
            //docTemp.Dispose(); // delete document
            // delete baked geometry quiet
            RhinoDocument.Objects.Delete(id, true);
            Rhino.RhinoApp.Write("Object deleted\n", true);
            Print(res);
        }
    }
}
# ---------- end script ----------
rh_cmds = Script()  # -> out, a; disabled
# ---------- rh_cmds: C# ----------
// Grasshopper Script Instance
#region Usings
using System;
using System.Linq;
using System.Collections;
using System.Collections.Generic;
using System.Drawing;

using Rhino;
using Rhino.Geometry;

using Grasshopper;
using Grasshopper.Kernel;
using Grasshopper.Kernel.Data;
using Grasshopper.Kernel.Types;
#endregion

public class Script_Instance : GH_ScriptInstance
{
    #region Notes
    /* 
      Members:
        RhinoDoc RhinoDocument
        GH_Document GrasshopperDocument
        IGH_Component Component
        int Iteration

      Methods (Virtual & overridable):
        Print(string text)
        Print(string format, params object[] args)
        Reflect(object obj)
        Reflect(object obj, string method_name)
    */
    #endregion

    private void RunScript(object x, object y, ref object a)
    {
        var filePath = @"C:\Data\CloudFlare\3d-models\ReceivingGH_GLTFs";
        filePath += @"\model1";
        string rhinoCommand = $"-SelLast _Enter";
        rhinoCommand = $"-SelLast _Enter _Export";
        Rhino.RhinoApp.RunScript(rhinoCommand, true);

        // Write your logic here
        a = null;
    }
}
# ---------- end rh_cmds ----------

# ---- group: multiple Geometries
number_slider_3 = Slider(0.739, range=0..1)
pt = ConstructPoint(XCoordinate=Slider(-42, range=-60..21), YCoordinate=0, ZCoordinate=0)
number_slider_4 = Slider(12, range=0..100)
box_2 = CenterBox(Base=pt, X=number_slider_3, Y=number_slider_3, Z=number_slider_3)
area = Area(Geometry=box_2)  # -> Area, Centroid
scale = Scale(Geometry=box_2, Center=area.Centroid, Factor=Slider(1.2, range=0..10))  # -> Geometry, Transform
arrbox = BoxArray(Geometry=box_2, Cell=scale.Geometry, XCount=number_slider_4, YCount=number_slider_4, ZCount=number_slider_4)  # -> Geometry, Transform

# ----
partition = PartitionList(List=arrbox.Geometry, Size=number_slider_4)

# ---- group: multiple Geometries (continued)
mbox_2 = MeshBox(Base=partition, XCount="1", YCount="1", ZCount="1")

# ----
gltfexp = GltfExporter(
    Export=button,
    FileName="model_03(VS)",
    Folder="C:\Data\CloudFlare\3d-models\ReceivingGH_GLTFs",
    GeometryCollection=mbox_2)
panel_4 = Panel(gltfexp)
